# Grasshopper definition GH_TEMPLATE_TIMO_withEvents.gh (Grasshopper 1.0.7)

# ----
# Do not copy/modify/remove this
# component without setting enable to false first!
out_outputs = ColourSwatch(SwatchColor=RGBA(255, 144, 54, 150))
g_general = ColourSwatch(SwatchColor=RGBA(217, 217, 217, 150))
i_inputs = ColourSwatch(SwatchColor=RGBA(255, 231, 54, 150))
wires_and_groups = CSharpScript(Colors=[i_inputs, out_outputs, g_general], Enable=Toggle(False), debug=Toggle(True))  # -> out; inputs Colors: list of Color, Enable: Boolean, debug: Boolean
# ---------- wires_and_groups: C# usings ----------
using System.Linq;
using System.Text;
# ---------- wires_and_groups: C# ----------
    msg.Clear();
    _debug = debug; //Set to true to have all events printed in rhino log

    if (Enable)
    {
      SetupDict(); // Create a dictionary of the input swatches
      SetEventHandlers(); // This would do the job.
    }
    else
    {
      RemoveEventHandlers();
    }

    Print(msg.ToString());


    // Component setup
    Component.Description = "Set up event handlers to color groups based on prefixes such as 'in_' and 'out_'.\n"
      + "Please insert only swatcheds directly into the Colors input\n"
      + "MIT License. Copyright Mathias Sønderskov Schaltz 2022";
    Component.Params.Input[0].Description = "Please insert only swatcheds directly into the Colors input.\nRemember to rename them";
    Component.Params.Input[1].Description = "Toggle to run...";
    Component.Params.Input[2].Description = "Set debug to true to get all the events printed in the rhino log";
# ---------- wires_and_groups: C# additional code ----------
  Dictionary<string, System.Drawing.Color> colorDict = new Dictionary<string, System.Drawing.Color>();
  StringBuilder msg = new StringBuilder();
  bool _debug = false;


  public void SetupDict()
  {
    colorDict.Clear();
    // Get all inputs to "Colors"
    IList<IGH_Param> colorSources = this.Component.Params.Input[0].Sources;
    if (colorSources.Count == 0)
    {
      throw new Exception("You forgot to setup the colors. Please input swatch components and rename them");
    }
    foreach(IGH_Param source in colorSources)
    {
      //if (source.Type.ToString() == "Grasshopper.Kernel.Types.GH_Colour")
      if (source is Grasshopper.Kernel.Special.GH_ColourSwatch)
      {
        string nickName = source.NickName.Split('_')[0].Trim() + '_';
        if(!colorDict.ContainsKey(nickName))
        {
          Grasshopper.Kernel.Special.GH_ColourSwatch swatch = (Grasshopper.Kernel.Special.GH_ColourSwatch) source;
          colorDict.Add(nickName, swatch.SwatchColour);
        }
        else
        {
          throw new Exception("Multiple swatches using the same name detected. Please rename");
        }
      }
      else
      {
        throw new Exception("Whacko! Why did you input a non-swatch into the Colors? " + source.Type.ToString());
      }

    }

    msg.AppendFormat("Set up the dictionaries with {0} colors\n", colorDict.Count);
    foreach(var pairs in colorDict)
    {
      msg.AppendFormat("{0} -> {1}\n", ("\"" + pairs.Key + "\"").PadRight(5 + colorDict.Keys.Select(k => k.Length).Max()), pairs.Value);
    }
  }

  public void SetEventHandlers()
  {

    // Always remove events first to avoid duplicates
    GrasshopperDocument.ObjectsAdded -= OnObjectsAdded;
    GrasshopperDocument.ObjectsDeleted -= OnObjectsRemoved;
    GrasshopperDocument.ObjectsDeleted -= DeleteThisComponent;

    // Attach events
    GrasshopperDocument.ObjectsAdded += OnObjectsAdded;
    GrasshopperDocument.ObjectsDeleted += OnObjectsRemoved;
    GrasshopperDocument.ObjectsDeleted += DeleteThisComponent;


    foreach(Grasshopper.Kernel.Special.GH_Group grp in GrasshopperDocument.Objects.OfType<Grasshopper.Kernel.Special.GH_Group>())
    {
      grp.ObjectChanged -= ColorGroup;
      grp.ObjectChanged += ColorGroup;

      ColorGroup(grp, null); // Make sure to run it once
    }
    msg.AppendFormat("Added the eventhandlers on {0} existing groups and on future created groups", GrasshopperDocument.Objects.OfType<Grasshopper.Kernel.Special.GH_Group>().Count());
  }

  public void OnObjectsAdded(object sender, GH_DocObjectEventArgs e)
  {
    bool any = false;
    foreach (Grasshopper.Kernel.Special.GH_Group grp in e.Objects.OfType<Grasshopper.Kernel.Special.GH_Group>())
    {
      grp.ObjectChanged -= ColorGroup;
      grp.ObjectChanged += ColorGroup;
      any = true;
    }

    DebugWrite(any ? "Group Objects Added: Attaching Events to ObjectChanged" : "Objects Added - but no groups");
  }

  //Same but reversed
  public void OnObjectsRemoved(object sender, GH_DocObjectEventArgs e)
  {
    bool any = false;
    foreach (Grasshopper.Kernel.Special.GH_Group grp in e.Objects.OfType<Grasshopper.Kernel.Special.GH_Group>())
    {
      grp.ObjectChanged -= ColorGroup;
      any = true;
    }

    DebugWrite(any ? "Group Objects Removed, removing event" : "Objects Removed - although not a group");

  }



  public void RemoveEventHandlers()
  {
    GrasshopperDocument.ObjectsAdded -= OnObjectsAdded;
    GrasshopperDocument.ObjectsDeleted -= OnObjectsRemoved;


    foreach(Grasshopper.Kernel.Special.GH_Group grp in GrasshopperDocument.Objects.OfType<Grasshopper.Kernel.Special.GH_Group>())
    {
      grp.ObjectChanged -= ColorGroup;

    }
    msg.AppendFormat("Removed event handlers on document and on {0} groups\n", GrasshopperDocument.Objects.OfType<Grasshopper.Kernel.Special.GH_Group>().Count());

  }

  public void ColorGroup(object sender, EventArgs e)
  {

    Grasshopper.Kernel.Special.GH_Group grp = sender as Grasshopper.Kernel.Special.GH_Group;
    if (grp == null) return; //not type GH_Group
    //if (!grp.NickName.EndsWith("_")) return;


    string prefix = grp.NickName.Split('_')[0].Trim() + '_';

    string prefixes = String.Join(", ", colorDict.Keys.Select(k => "\"" + k + "\""));


    if (colorDict.ContainsKey(prefix))
    {
      if (grp.NickName.EndsWith("_"))
        grp.Colour = colorDict[prefix];
      grp.NickName = grp.NickName.Replace(prefix, "");

      DebugWrite("Colored " + grp.NickName);

    }
    else
    {
      //DebugWrite("Group changed but not relevant: prefix " + prefix + " is not among " + prefixes);
    }

  }
  public void DebugWrite(string msg)
  {
    if (_debug)
    {
      Rhino.RhinoApp.WriteLine(msg);
    }
  }

  public void DeleteThisComponent(object sender, GH_DocObjectEventArgs e)
  {

    if (e.Objects.OfType<Grasshopper.Kernel.GH_Component>().Where(o => o.NickName == this.Component.NickName).Any())
    {
      DebugWrite("Removed template component. Removing all the eventhandlers");
      RemoveEventHandlers();
    }


  }
# ---------- end wires_and_groups ----------
# Script by:
# Timo Harboe Nielsen
panel = Panel(wires_and_groups)

# ---- group: i_daw
authornames = CSharpScript(SetNameToWindowsName=Button(), ResetName=Button())  # -> out; inputs SetNameToWindowsName: Boolean, ResetName: Boolean
# ---------- authornames: C# ----------
    if(SetNameToWindowsName)
    {
      if (string.Equals(Grasshopper.CentralSettings.AuthorName, Environment.UserName, StringComparison.InvariantCulture))
      {

        msg = "Didn't change author name, as it was already set to " + Environment.UserName;
      }
      else
      {
        oldName = Grasshopper.CentralSettings.AuthorName;
        Grasshopper.CentralSettings.AuthorName = Environment.UserName;
        msg = "Changed author name to " + Environment.UserName + "\nThe old name was " + oldName;
      }
    }

    if (ResetName && !String.IsNullOrEmpty(oldName))
    {
      Grasshopper.CentralSettings.AuthorName = oldName;
      msg = "Reset author name to " + oldName;
    }

    Print(msg);
# ---------- authornames: C# additional code ----------
  string oldName = string.Empty;
  string msg = string.Empty;
# ---------- end authornames ----------
panel_2 = Panel(authornames)

# ---- group: Canvas Settings / _in
change_background_color = Button()
update_wires_and_groups = Button()

# ----
group_names_to_ignore = Panel("_ignore")

# ---- group: Input _in
num = Number(Slider(1.675, range=0..10))

# ---- group: Other Namedd
num_2 = Number(num)
# Example script - can be deleted
addition = Addition(A=num_2, B=num_2)
num_3 = Number(addition)

# ---- group: _ignore
num_4 = Number(num_3)
num_5 = Number(num_4)

# ---- group: Canvas Settings
group_names_corresponding_to_colors_belo = Panel("""_in
_analysis
_out
_visual""")  # "Group names corresponding to colors below"
groups_with_hidden_wires = Panel("_visual")
color = ColourSwatch(SwatchColor=RGBA(255, 231, 54, 150))
color_2 = ColourSwatch(SwatchColor=RGBA(255, 189, 189, 150))
color_3 = ColourSwatch(SwatchColor=RGBA(156, 255, 215, 150))
color_4 = ColourSwatch(SwatchColor=RGBA(232, 224, 255, 150))
merge = Merge(Data1=color, Data2=color_4, Data3=color_2, Data4=color_3)
color_5 = ColourSwatch(SwatchColor=RGBA(227, 227, 227, 90))
changebackground = GhPythonScript(
    change=change_background_color,
    newBackgroundColor=ColourSwatch(SwatchColor=RGB(209, 209, 205)),
    wireColor=RGB(110, 110, 110),
    selectedWireColor=RGB(47, 255, 0))  # inputs newBackgroundColor: Color, wireColor: Color, selectedWireColor: Color
# ---------- changebackground: Python ----------
import Grasshopper as gh
import rhinoscriptsyntax as rs

newShadeColor = rs.CreateColor(0,0,0,20)
newEdgeColor = rs.CreateColor(0,0,0,40)

if(change):
     gh.GUI.Canvas.GH_Skin.canvas_back = newBackgroundColor
     gh.GUI.Canvas.GH_Skin.canvas_shade = newShadeColor
     gh.GUI.Canvas.GH_Skin.canvas_edge = newEdgeColor
     gh.GUI.Canvas.GH_Skin.wire_default = wireColor
     gh.GUI.Canvas.GH_Skin.wire_selected_a = selectedWireColor
     gh.GUI.Canvas.GH_Skin.wire_selected_b = selectedWireColor
# ---------- end changebackground ----------

# ----
bool = Boolean(invert(update_wires_and_groups))
wdt = FaintWires(updateWires=bool, hiddenGroups=groups_with_hidden_wires, Enable=Toggle(True))  # inputs updateWires: Boolean, hiddenGroups: list of String, Enable: Boolean
# ---------- wdt: C# usings ----------
using System.IO;
using System.Linq;
using System.Data;
using System.Drawing;
using System.Reflection;
using System.Windows.Forms;
using System.Xml;
using System.Xml.Linq;
using System.Runtime.InteropServices;

using Rhino.DocObjects;
using Rhino.Collections;
using GH_IO;
using GH_IO.Serialization;

using Grasshopper.Kernel.Special;
# ---------- wdt: C# ----------
    _hiddenGroups = hiddenGroups;
    _updateWires = updateWires;

    if(Enable)
    {
      Grasshopper.Instances.ActiveCanvas.Document.SolutionEnd -= OnSolutionEnd;
      Grasshopper.Instances.ActiveCanvas.Document.SolutionEnd += OnSolutionEnd;
    }
    else
    {
      Grasshopper.Instances.ActiveCanvas.Document.SolutionEnd -= OnSolutionEnd;
    }
# ---------- wdt: C# additional code ----------
  List<string> _hiddenGroups;
  bool _updateWires;

  void OnSolutionEnd(object sender, GH_SolutionEventArgs e)
  {
    RunItAll();
  }
  void RunItAll()
  {

    //Get ID's of objects in desired groups

    GH_Document doc = owner.OnPingDocument();
    List<System.Guid> objectIDs = new List<System.Guid>();
    foreach (var dobj in doc.Objects)
    {

      GH_Group _group = dobj as GH_Group;
      if( _group == null){
        continue;
      }
      for(int i = 0; i < _hiddenGroups.Count; i++){
        string groupName = _group.NickName.ToString();
        string compareName = _hiddenGroups[i];
        if(groupName.IndexOf(compareName, StringComparison.OrdinalIgnoreCase) >= 0){
          objectIDs.AddRange(_group.ObjectIDs);
          break;
        }
      }
    }

    // Manipulate wires
    foreach(IGH_ActiveObject activeObject in GrasshopperDocument.ActiveObjects()){
      if(activeObject.SubCategory == "Primitive" || activeObject.SubCategory == "Geometry"){
        if(activeObject is IGH_Param){
          IGH_Param param = activeObject as IGH_Param;
          int wire = 0;  //0 default, 1 faint, 2 hidden
          for(int i = 0; i < param.SourceCount; i++){
            IGH_ActiveObject activeObjectSource = param.Sources[i].Attributes.GetTopLevel.DocObject as IGH_ActiveObject;
            if(activeObjectSource.SubCategory == "Primitive" || activeObjectSource.SubCategory == "Geometry"){
              if(objectIDs.Contains(activeObject.InstanceGuid) && !objectIDs.Contains(activeObjectSource.InstanceGuid)){
                wire = 2;
              } else {
                wire = 1;
              }
            } else{
              wire = 0;
              break;
            }
          }
          if(wire == 1){
            fixWires(param, _updateWires);
          }
          if(wire == 2){
            hideWires(param, _updateWires);
          }

        }
      }
    }
  }
  void fixWires(IGH_Param param, bool showFaint){
    if(showFaint){
      param.WireDisplay = GH_ParamWireDisplay.faint;
    } else{
      GH_ParamWireDisplay ParameterDisplayDefault = (GH_ParamWireDisplay) 0;
      param.WireDisplay = ParameterDisplayDefault;
    }
  }

  void hideWires(IGH_Param param, bool showFaint){
    if(showFaint){
      param.WireDisplay = GH_ParamWireDisplay.hidden;
    } else{
      GH_ParamWireDisplay ParameterDisplayDefault = (GH_ParamWireDisplay) 0;
      param.WireDisplay = ParameterDisplayDefault;
    }
  }
# ---------- end wdt ----------

# ---- group: Canvas Settings (continued)
group_color = GroupColor(
    run=bool,
    groupNames=group_names_corresponding_to_colors_belo,
    groupNamesIgnore=group_names_to_ignore,
    colors=merge,
    defaultColor=color_5)  # inputs run: Boolean, groupNames: list of String, groupNamesIgnore: list of String, colors: list of Color, defaultColor: Color
# ---------- group_color: C# usings ----------
using System.Drawing;
using Grasshopper.Kernel.Special;
# ---------- group_color: C# ----------
    // Created by Timo Harboe Nielsen - Rambøll.

    if(!run){
      return;
    }
    GH_Document doc = owner.OnPingDocument();
    foreach (var dobj in doc.Objects)
    {
      GH_Group _group = dobj as GH_Group;
      if( _group == null){
        continue;
      }
      string groupName = _group.NickName.ToString();

      bool changeColor = true;
      //Check if groupName is to be ignored
      for(int i = 0; i < groupNamesIgnore.Count; i++){
        string compareName = groupNamesIgnore[i];
        if(groupName.IndexOf(compareName, StringComparison.OrdinalIgnoreCase) >= 0){
          changeColor = false;
        }
      }

      if(!changeColor){continue;}

      for(int i = 0; i < Math.Min(groupNames.Count, colors.Count); i++){
        string compareName = groupNames[i];
        if(groupName.IndexOf(compareName, StringComparison.OrdinalIgnoreCase) >= 0){
          _group.Colour = colors[i];
          break;
        } else{
          _group.Colour = defaultColor;
        }
      }
    }
# ---------- end group_color ----------

# ---- group: Analysis _analysis
geo = Geometry([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])
num_6 = Number(num_5)
Z = UnitZ(Factor=num_6)
extr = Extrude(Base=geo, Direction=Z)

# ----
cap = CapHoles(Brep=extr)

# ---- group: Analysis _analysis (continued)
geo_2 = Geometry(cap)

# ---- group: Visualisation _visual
geo_3 = Geometry(geo_2)
wires = BrepWireframe(Brep=geo_3, Density=-1)
preview = CustomPreview(
    Geometry=geo_3,
    Material={diffuse=RGB(0, 174, 255), emission=RGB(0, 52, 76), shine=0.5, specular=RGB(255, 255, 255), transparency=0})
preview_2 = CustomPreview(
    Geometry=wires,
    Material={diffuse=RGB(0, 0, 0), emission=RGB(0, 0, 0), shine=0.5, specular=RGB(255, 255, 255), transparency=0})

# ---- group: Output _out
geo_4 = Geometry(geo_2)
