# Grasshopper definition RhinoInside.Revit - GetWindows.gh (Grasshopper 1.0.7)
# Copyright: 2021
# Copyright: 2021-20-24

# ----
# COPYRIGHT LINK ARKITEKTUR 2021:
# 
# This script is not to be shared with anyone outside project scope.
# Template Full
pr = Panel("00000")
grasshopper_folder = Panel("C:\Users\mm1013\source\repos\GrasshopperScribbles")
username = Panel("Mathias Sønderskov Schaltz")
toolversion = Panel("1.0.0")
grasshopper_file = Panel("RhinoInside.Revit - GetWindows")
# share project
# RiR - Get windows
# Template Headers
toolname = Panel("RiR - Get windows")
project = Panel("share project")

# ---- group: gi_
# Colors
# Inputs
geometry = Data(0)

# ---- group: pi_
param = Data(0)

# ---- group: oi_
other = Data(0)

# ---- group: 1_
data = Data(0)

# ---- group: 2_
data_2 = Data(0)

# ---- group: 3_
data_3 = Data(0)

# ---- group: r_
# Custom
rev = Data(0)

# ---- group: g_
# Group
general = Data(0)

# ---- group: c_
core = Data(0)

# ---- group: o_
# Out
output = Data(0)

# ---- group: v_
# Revision
visual = Data(0)

# ----
# Link your revit window element here
cluster = Cluster()  # -> frames_2, glass
frames_mesh = Mesh(cluster.frames_2)
glass_breps = Brep(cluster.glass)

# ==== cluster Cluster
preview = ElementPreview(Element=ClusterInput(), DetailLevel=1)  # -> Meshes, Materials, Wires
python = GhPythonScript(x=preview.Materials)  # -> out, a
# ---------- python: Python ----------
__author__ = "mm1013"
__version__ = "2021.12.03"

import clr
clr.AddReference('System.Core')
clr.AddReference('RhinoInside.Revit')
clr.AddReference('RevitAPI') 
clr.AddReference('RevitAPIUI')

from System import Enum

import rhinoscriptsyntax as rs
import Rhino
import RhinoInside
import Grasshopper as GH
from RhinoInside.Revit import Revit
from Autodesk.Revit import DB

# loading extension methods are necessary to access convertor methods
# e.g. Solid.ToBrep()
clr.ImportExtensions(RhinoInside.Revit.Convert.Geometry)

doc = Revit.ActiveDBDocument

import rhinoscriptsyntax as rs

#a = x.Id.IntegerValue

a = doc.GetElement(DB.ElementId(x.Id.IntegerValue)).Transparency
# ---------- end python ----------
cull = CullPattern(List=preview.Meshes, CullPattern=invert(python.a))
cull_2 = CullPattern(List=preview.Meshes, CullPattern=python.a)
get_windows = GetWindows(mesh=cull_2)
frames = Mesh(cull)
glass = ClusterOutput(get_windows)
frames_2 = ClusterOutput(frames)

# ==== cluster GetWindows
mesh = ClusterInput()
mesh_2 = Mesh(mesh)
disjoint = DisjointMesh(Mesh=mesh_2)
mesh_explode = MeshExplode(m=disjoint)  # -> out, simplify(A)
# ---------- mesh_explode: VB ----------
    Component.Params.Input(0).Name = "Mesh"
    Component.Params.Input(0).Description = "Open or closed mesh"

    Component.Params.Output(1).Name = "Mesh"
    Component.Params.Output(1).Description = "If successful, a valid mesh"

    If m IsNot Nothing Then
      Dim pts As Rhino.Geometry.Collections.MeshVertexList
      Dim faces As Rhino.Geometry.Collections.MeshFaceList
      Dim clrs As Rhino.Geometry.Collections.MeshVertexColorList
      Dim i As Integer
      Dim mshs As New list(Of mesh)

      faces = m.Faces
      pts = m.Vertices
      If m.VertexColors.count() = 0 Then m.VertexColors.CreateMonotoneMesh(color.FromArgb(100, 100, 100))
      clrs = m.VertexColors

      For i = 0 To faces.count() - 1 Step 1
        Dim fc As New meshFace
        Dim face As New MeshFace
        Dim ptList As New list(Of point3d)
        Dim clrList As New list(Of color)
        Dim msh As New mesh

        face = faces(i)

        ptList.add(New point3d(pts(face.A)))
        ptList.add(New point3d(pts(face.B)))
        ptList.add(New point3d(pts(face.C)))
        If face.IsQuad Then ptList.add(New point3d(pts(face.D)))

        clrList.add(clrs(face.A))
        clrList.add(clrs(face.B))
        clrList.add(clrs(face.C))
        If face.IsQuad Then clrList.add(clrs(face.D))

        If face.IsQuad Then fc = New meshFace(0, 1, 2, 3) Else fc = New meshface(0, 1, 2)

        msh.Vertices.AddVertices(ptList.toarray())
        msh.Faces.AddFace(fc)
        msh.VertexColors.SetColors(clrList.toarray())
        mshs.add(msh)
      Next

      A = mshs
    End If
# ---------- end mesh_explode ----------
facen = FaceNormals(Mesh=disjoint)  # -> Centers, simplify(Normals)
item = ListItem(List=facen.Normals, Index=0, Wrap=True)
viewer = ParamViewer(item)
cset = CreateSet(List=facen.Normals)  # -> Set, Map
data = Data(graft(viewer))
unflatten = UnflattenTree(Tree=data, Guide=item)
long = LongestList(ListA=unflatten, ListB=cset.Map, PaddingMode=2)  # -> graft(ListA), graft(ListB)
dpath = DeconstructPath(Branch=long.ListA)  # -> simplify(Indices)
merge = Merge(Data1=dpath, Data2=long.ListB)
path = ConstructPath(Indices=merge)
assign_paths = AssignPaths(InputData=flatten(mesh_explode.A), PathsToAssign=flatten(path))
mjoin = MeshJoin(Meshes=assign_paths)
shift = ShiftPaths(Data=mjoin, Offset=-1)
area = Area(Geometry=shift)  # -> Area, Centroid
sort = SortList(Keys=area.Area, ValuesA=shift)  # -> Keys, reverse(ValuesA)
item_2 = ListItem(List=sort.ValuesA, Index=0, Wrap=True)  # -> Item, Item1
weld = WeldMesh(Mesh=item_2.Item, Angle=3.141592654)
weld_2 = WeldMesh(Mesh=item_2.Item1, Angle=3.141592654)
quad = Quadrangulate(Mesh=weld, Angle=0.03490658504, Ratio=0.875)  # -> Mesh, Count
quad_2 = Quadrangulate(Mesh=weld_2, Angle=0.03490658504, Ratio=0.875)  # -> Mesh, Count
facen_2 = FaceNormals(Mesh=quad_2.Mesh)  # -> Centers, Normals
facen_3 = FaceNormals(Mesh=quad.Mesh)  # -> Centers, Normals
dist = Distance(PointA=facen_3.Normals, PointB="100,100,100")
dist_2 = Distance(PointA=facen_2.Normals, PointB="100,100,100")
larger = LargerThan(FirstNumber=dist, SecondNumber=dist_2)  # -> LargerThan, OrEqualTo
cull = CullPattern(List=quad.Mesh, CullPattern=invert(larger.LargerThan))  # -> simplify(List)
cull_2 = CullPattern(List=quad_2.Mesh, CullPattern=larger.LargerThan)  # -> simplify(List)
shift_2 = ShiftPaths(Data=[cull_2, cull], Offset=-1)
medges = MeshEdges(Mesh=shift_2)  # -> NakedEdges, InteriorEdges, NonManifoldEdges
join = JoinCurves(Curves=medges.NakedEdges, Preserve=False)
boundary = BoundarySurfaces(Edges=join)  # -> simplify(Surfaces)
abc_a = ABC(data=boundary)
c_script = CSharpScript(x=abc_a)  # -> A; inputs x: list of Brep
# ---------- c_script: C# ----------
    if (x.Count > 1)
    {
      Brep b = x[0];
      for (int i = 1; i < x.Count; i++)
      {
			 b.Append(x[i]);
      }
      
      A = b;
    }
    else

    {
      A = x;
    }
# ---------- end c_script ----------
brep = Brep(c_script)
brep_2 = ClusterOutput(brep)

# ==== cluster ABC
data = ClusterInput()
data_2 = Data(data)
path_mapper = PathMapper(
    data_2,
    source=["{A;B;C;D;E;F;G}", "{A;B;C;D;E;F}", "{A;B;C;D;E}", "{A;B;C;D}", "{A;B;C}", "{A;B}", "{A}"],
    target=["{A}", "{A}", "{A}", "{A}", "{A}", "{A}", "{A}"])
data_3 = Data(path_mapper)
data_4 = ClusterOutput(data_3)
